# Grasshopper definition xmas_tree_coord_normalizer.gh (Grasshopper 1.0.7)

# #GSD6338
# Introduction to Computational Design
# Instructor: Jose Luis García del Castillo y López
# Harvard University Graduate School of Design
# Holiday Tree LED Light Animation
# 
# This file is part of a class assignment for GSD6338: Introduction to Computational Design, and the Harvard University Graduate School of Design.
c_script = CSharpScript()  # -> out, here
# ---------- c_script: C# usings ----------
using System.IO;
# ---------- c_script: C# ----------
    string targetFolder = "";

    GH_Document gh_d = owner.OnPingDocument();
    if (gh_d.IsFilePathDefined)
    {
      string ghFilePath = gh_d.FilePath;
      targetFolder = Path.GetDirectoryName(ghFilePath);
    }
    else
    {
      Print("No local folder found, please save your file first.");
    }

    here = targetFolder;
# ---------- end c_script ----------
concat = Concatenate(FragmentA=c_script.here, FragmentB="\", FragmentC="coords_adjusted.txt")
panel = Panel(concat)
file = ReadFile(File=concat, PerLineParse=True)

# ---- group: Parse tree LED coordinates into a point cloud
c_script_2 = CSharpScript(coord=file)  # -> out, P; inputs coord: String
# ---------- c_script_2: C# ----------
    string str = coord.Replace("[", "");
    str = str.Replace("]", "");
    str = str.Replace(" ", "");
    string[] coordsStr = str.Split(',');
    if (coordsStr.Length != 3)
    {
      Component.AddRuntimeMessage(GH_RuntimeMessageLevel.Error, "Invalid string");
      return;
    }

    double x = 0, y = 0, z = 0;
    try
    {
      x = Double.Parse(coordsStr[0]);
      y = Double.Parse(coordsStr[1]);
      z = Double.Parse(coordsStr[2]);
    }
    catch (Exception ex)
    {
      Component.AddRuntimeMessage(GH_RuntimeMessageLevel.Error, "Invalid string: " + ex.ToString());
    }

    P = new Point3d(x, y, z);
# ---------- end c_script_2 ----------

# ----
panel_2 = Panel(file)
c_script_3 = CSharpScript(pts=c_script_2.P)  # -> out, norm, strings; inputs pts: list of Point3d
# ---------- c_script_3: C# ----------
    BoundingBox bb = new BoundingBox(pts);

    // Find worst X or Y and scale it down to 1
    Transform scale = Transform.Scale(bb.Min, 1.0 /
      bb.Diagonal.X > bb.Diagonal.Y ? 2.0 / bb.Diagonal.X : 2.0 / bb.Diagonal.Y);
    bb.Transform(scale);

    Vector3d baseCenter = new Vector3d(
      bb.Min.X + 0.5 * bb.Diagonal.X,
      bb.Min.Y + 0.5 * bb.Diagonal.Y,
      bb.Min.Z);

    Transform move = Transform.Translation(-baseCenter);

    List<string> csv = new List<string>();
    csv.Add("ID,X,Y,Z");

    Transform xform = move * scale;
    List<Point3d> normPts = new List<Point3d>();
    for (int i = 0; i < pts.Count; i++)
    {
      Point3d p = pts[i];
      p.Transform(xform);
      normPts.Add(p);
      csv.Add(String.Format("{0},{1},{2},{3}",
        i,
        Math.Round(p.X, 4),
        Math.Round(p.Y, 4),
        Math.Round(p.Z, 4)));
    }

    // Outputs
    norm = normPts;
    strings = csv;
# ---------- end c_script_3 ----------
panel_3 = Panel(c_script_3.strings)
bbox = BoundingBox(Content=c_script_3.norm, Plane=PlaneXY(0, 0, 0), UnionBox=True)  # -> Box, Box_2
debox = DeconstructBox(Box=bbox.Box)  # -> Plane, X, Y, Z
panel_4 = Panel(c_script_2.P)
concat_2 = Concatenate(FragmentA=c_script.here, FragmentB="\", FragmentC="coords_adjusted_normalized.csv")

# ---- group: Save the CSV locally
c_script_4 = CSharpScript(text=c_script_3.strings, path=concat_2)  # -> out; inputs text: list of String, path: String
# ---------- c_script_4: C# usings ----------
using System.IO;
using System.Text;
# ---------- c_script_4: C# ----------
    // This file takes a list of strings and saves them to a file somewhere in your system

    try
    {
      File.WriteAllLines(path, text, Encoding.UTF8);

      string msg = text.Count + " lines successfully written to file " + path + " on " + DateTime.Now;
      Print(msg);

    }
    catch (Exception ex)
    {
      this.Component.AddRuntimeMessage(GH_RuntimeMessageLevel.Error, "Something went wrong saving the file: " + ex);
    }
# ---------- end c_script_4 ----------
panel_5 = Panel(c_script_4)

# ----
panel_6 = Panel(concat_2)
