# Grasshopper definition xmas_tree_sequences_no_3d.gh (Grasshopper 1.0.7)

# ---- group: Load LED spatial locations
c_script = CSharpScript()  # -> out, here
# ---------- c_script: C# usings ----------
using System.IO;
# ---------- c_script: C# ----------
    string targetFolder = "";

    GH_Document gh_d = owner.OnPingDocument();
    if (gh_d.IsFilePathDefined)
    {
      string ghFilePath = gh_d.FilePath;
      targetFolder = Path.GetDirectoryName(ghFilePath);
    }
    else
    {
      Print("No local folder found, please save your file first.");
    }

    here = targetFolder;
# ---------- end c_script ----------
concat = Concatenate(FragmentA=c_script.here, FragmentB="\", FragmentC="coords_adjusted_normalized.csv")
panel = Panel(concat)
file = ReadFile(File=concat, PerLineParse=True)
panel_2 = Panel(file)
split = SplitList(List=file, Index="1")  # -> ListA, ListB
panel_3 = Panel(split.ListB)
c_script_2 = CSharpScript(coord=split.ListB)  # -> out, P; inputs coord: String
# ---------- c_script_2: C# ----------
  
    string[] parts = coord.Split(',');
    
    double x = 0, y = 0, z = 0;
    try
    {
      x = Double.Parse(parts[1]);
      y = Double.Parse(parts[2]);
      z = Double.Parse(parts[3]);
    }
    catch (Exception ex)
    {
      Component.AddRuntimeMessage(
      GH_RuntimeMessageLevel.Error, 
      "Invalid string: " + ex.ToString());
    }
    
    Point3d p = new Point3d(x, y, z);
    
    
    P = p;
# ---------- end c_script_2 ----------
panel_4 = Panel(c_script_2.P)
pt = Point(c_script_2.P)

# ----
path = FilePath(c_script.here)
concat_2 = Concatenate(FragmentA=path, FragmentB="\", FragmentC="random-blinking.csv")

# ---- group: COMPLETE RANDOM BLINKING
c_script_3 = CSharpScript(leds=pt, fps=Slider(60, range=0..100), duration=Slider(10, range=0..10))  # -> out, CSV; inputs leds: list of Point3d, fps: Int32, duration: Int32
# ---------- c_script_3: C# ----------
    // Algorithm

    // How many lights do we have?
    int ledCount = leds.Count;

    // Prepare the basics of our CSV file
    List<string> csv = new List<string>();

    // Add the header, looking like:
    // "FRAME_ID,R_0,G_0,B_0,R_1,G_1,B_1..."
    string row = "FRAME_ID,";
    for (int i = 0; i < ledCount; i++)
    {
      row += "R_" + i + ",G_" + i + ",B_" + i;
      if (i != ledCount - 1)
      {
        row += ",";
      }
    }
    csv.Add(row);

    // Total length of animation
    int frameCount = fps * duration;

    // Create a random generator
    Random rnd = new Random();

    // Generate rows for each frame
    for (int f = 0; f < frameCount; f++)
    {
      row = f + ",";

      // Calculate the values for each LED
      int r, g, b;
      for (int i = 0; i < ledCount; i++)
      {
        // Calculate RGB values for each LED
        int ran = rnd.Next(0, 256);
        r = ran;
        g = ran;
        b = ran;

        // Add these colors to the row
        row += r + "," + g + "," + b;
        if (i != ledCount - 1)
        {
          row += ",";
        }
      }

      // Add this row to the CSV
      csv.Add(row);
    }


    // Outputs
    CSV = csv;
# ---------- end c_script_3 ----------
panel_5 = Panel(c_script_3.CSV)
c_script_4 = CSharpScript(csv=c_script_3.CSV, path=concat_2)  # -> out; inputs csv: list of String, path: String
# ---------- c_script_4: C# usings ----------
using System.IO;
using System.Text;
# ---------- c_script_4: C# ----------
  
    try 
    {
      File.WriteAllLines(path, csv, Encoding.UTF8);
      Print("File successfully saved on " + DateTime.Now);
    }
    catch (Exception ex)
    {
      this.Component.AddRuntimeMessage(
        GH_RuntimeMessageLevel.Error,
        "Could not save file, error: " + ex);
    }
# ---------- end c_script_4 ----------
panel_6 = Panel(c_script_4)

# ----
concat_3 = Concatenate(FragmentA=path, FragmentB="\", FragmentC="random-blinking-color.csv")

# ---- group: COMPLETE RANDOM BLINKING COLOR
c_script_5 = CSharpScript(leds=pt, fps=Slider(60, range=0..100), duration=Slider(10, range=0..10))  # -> out, CSV; inputs leds: list of Point3d, fps: Int32, duration: Int32
# ---------- c_script_5: C# ----------
    // Algorithm

    // How many lights do we have?
    int ledCount = leds.Count;

    // Prepare the basics of our CSV file
    List<string> csv = new List<string>();

    // Add the header, looking like:
    // "FRAME_ID,R_0,G_0,B_0,R_1,G_1,B_1..."
    string row = "FRAME_ID,";
    for (int i = 0; i < ledCount; i++)
    {
      row += "R_" + i + ",G_" + i + ",B_" + i;
      if (i != ledCount - 1)
      {
        row += ",";
      }
    }
    csv.Add(row);

    // Total length of animation
    int frameCount = fps * duration;

    // Create a random generator
    Random rnd = new Random();

    // Generate rows for each frame
    for (int f = 0; f < frameCount; f++)
    {
      row = f + ",";

      // Calculate the values for each LED
      int r, g, b;
      for (int i = 0; i < ledCount; i++)
      {
        // Calculate RGB values for each LED
        r = rnd.Next(0, 256);
        g = rnd.Next(0, 256);
        b = rnd.Next(0, 256);

        // Add these colors to the row
        row += r + "," + g + "," + b;
        if (i != ledCount - 1)
        {
          row += ",";
        }
      }

      // Add this row to the CSV
      csv.Add(row);
    }


    // Outputs
    CSV = csv;
# ---------- end c_script_5 ----------
panel_7 = Panel(c_script_5.CSV)
c_script_6 = CSharpScript(csv=c_script_5.CSV, path=concat_3)  # -> out; inputs csv: list of String, path: String; same code as c_script_4
panel_8 = Panel(c_script_6)

# ----
concat_4 = Concatenate(FragmentA=path, FragmentB="\", FragmentC="flush.csv")

# ---- group: FLUSH
c_script_7 = CSharpScript(leds=pt, fps=Slider(60, range=0..100), duration=Slider(1, range=0..10))  # -> out, CSV; inputs leds: list of Point3d, fps: Int32, duration: Int32
# ---------- c_script_7: C# ----------
    // Algorithm

    // How many lights do we have?
    int ledCount = leds.Count;

    // Prepare the basics of our CSV file
    List<string> csv = new List<string>();

    // Add the header, looking like:
    // "FRAME_ID,R_0,G_0,B_0,R_1,G_1,B_1..."
    string row = "FRAME_ID,";
    for (int i = 0; i < ledCount; i++)
    {
      row += "R_" + i + ",G_" + i + ",B_" + i;
      if (i != ledCount - 1)
      {
        row += ",";
      }
    }
    csv.Add(row);

    // Total length of animation
    int frameCount = fps * duration;

    // Generate rows for each frame
    for (int f = 0; f < frameCount; f++)
    {
      row = f + ",";

      // Calculate the values for each LED
      int r, g, b;
      for (int i = 0; i < ledCount; i++)
      {
        // Calculate RGB values for each LED

        // For this one, all LEDs are black.
        r = 0;
        g = 0;
        b = 0;

        // Add these colors to the row
        row += r + "," + g + "," + b;
        if (i != ledCount - 1)
        {
          row += ",";
        }
      }

      // Add this row to the CSV
      csv.Add(row);
    }


    // Outputs
    CSV = csv;
# ---------- end c_script_7 ----------
panel_9 = Panel(c_script_7.CSV)
c_script_8 = CSharpScript(csv=c_script_7.CSV, path=concat_4)  # -> out; inputs csv: list of String, path: String; same code as c_script_4
panel_10 = Panel(c_script_8)

# ----
concat_5 = Concatenate(FragmentA=path, FragmentB="\", FragmentC="pulse-random.csv")

# ---- group: PULSE RANDOM
c_script_9 = CSharpScript(leds=pt, fps=Slider(60, range=0..100), duration=Slider(2, range=0..10))  # -> out, CSV; inputs leds: list of Point3d, fps: Int32, duration: Int32
# ---------- c_script_9: C# ----------
    // Algorithm

    // How many lights do we have?
    int ledCount = leds.Count;

    // Prepare the basics of our CSV file
    List<string> csv = new List<string>();

    // Add the header, looking like:
    // "FRAME_ID,R_0,G_0,B_0,R_1,G_1,B_1..."
    string row = "FRAME_ID,";
    for (int i = 0; i < ledCount; i++)
    {
      row += "R_" + i + ",G_" + i + ",B_" + i;
      if (i != ledCount - 1)
      {
        row += ",";
      }
    }
    csv.Add(row);

    // Total length of animation
    int frameCount = fps * duration;

    // Angle step for each frame
    double thetaStep = 2 * Math.PI / frameCount;

    // Generate random initial angles for each LED light
    Random rand = new Random();
    List<double> initTheta = new List<double>();
    for (int i = 0; i < ledCount; i++)
    {
      double rt = 2 * Math.PI * rand.NextDouble();
      initTheta.Add(rt);
    }


    // Generate rows for each frame
    for (int f = 0; f < frameCount; f++)
    {
      row = f + ",";


      // Calculate the values for each LED
      int r, g, b;
      for (int i = 0; i < ledCount; i++)
      {
        // Calculate RGB values for each LED
        double theta = thetaStep * f;
        double amplitude = 0.5 + 0.5 * Math.Sin(theta - 0.5 * Math.PI + initTheta[i]);
        Print("Frame " + f + ", theta: " + theta + ", amplitude: " + amplitude);

        int brightness = (int) Math.Round(255 * amplitude);

        // For this one, all LEDs are black.
        r = brightness;
        g = brightness;
        b = brightness;

        // Add these colors to the row
        row += r + "," + g + "," + b;
        if (i != ledCount - 1)
        {
          row += ",";
        }
      }

      // Add this row to the CSV
      csv.Add(row);
    }


    // Outputs
    CSV = csv;
# ---------- end c_script_9 ----------
panel_11 = Panel(c_script_9.CSV)
c_script_10 = CSharpScript(csv=c_script_9.CSV, path=concat_5)  # -> out; inputs csv: list of String, path: String; same code as c_script_4
panel_12 = Panel(c_script_10)

# ----
concat_6 = Concatenate(FragmentA=path, FragmentB="\", FragmentC="pulse-offset.csv")

# ---- group: PULSE OFFSET
c_script_11 = CSharpScript(leds=pt, fps=Slider(60, range=0..100), duration=Slider(3, range=0..10))  # -> out, CSV; inputs leds: list of Point3d, fps: Int32, duration: Int32
# ---------- c_script_11: C# ----------
    // Algorithm

    // How many lights do we have?
    int ledCount = leds.Count;

    // Prepare the basics of our CSV file
    List<string> csv = new List<string>();

    // Add the header, looking like:
    // "FRAME_ID,R_0,G_0,B_0,R_1,G_1,B_1..."
    string row = "FRAME_ID,";
    for (int i = 0; i < ledCount; i++)
    {
      row += "R_" + i + ",G_" + i + ",B_" + i;
      if (i != ledCount - 1)
      {
        row += ",";
      }
    }
    csv.Add(row);

    // Total length of animation
    int frameCount = fps * duration;

    // Angle step for each frame
    double thetaStep = 2 * Math.PI / frameCount;

    // Generate slight offset initial angles for each LED light
    List<double> initTheta = new List<double>();
    for (int i = 0; i < ledCount; i++)
    {
      double rt = 2 * Math.PI / ledCount * i;
      initTheta.Add(rt);
    }


    // Generate rows for each frame
    for (int f = 0; f < frameCount; f++)
    {
      row = f + ",";


      // Calculate the values for each LED
      int r, g, b;
      for (int i = 0; i < ledCount; i++)
      {
        // Calculate RGB values for each LED
        double theta = thetaStep * f;
        double amplitude = 0.5 + 0.5 * Math.Sin(theta - 0.5 * Math.PI + initTheta[i]);
        Print("Frame " + f + ", theta: " + theta + ", amplitude: " + amplitude);

        int brightness = (int) Math.Round(255 * amplitude);

        // For this one, all LEDs are black.
        r = brightness;
        g = brightness;
        b = brightness;

        // Add these colors to the row
        row += r + "," + g + "," + b;
        if (i != ledCount - 1)
        {
          row += ",";
        }
      }

      // Add this row to the CSV
      csv.Add(row);
    }


    // Outputs
    CSV = csv;
# ---------- end c_script_11 ----------
panel_13 = Panel(c_script_11.CSV)
c_script_12 = CSharpScript(csv=c_script_11.CSV, path=concat_6)  # -> out; inputs csv: list of String, path: String; same code as c_script_4
panel_14 = Panel(c_script_12)

# ----
concat_7 = Concatenate(FragmentA=path, FragmentB="\", FragmentC="pulse-uniform.csv")

# ---- group: PULSE UNIFORM
c_script_13 = CSharpScript(leds=pt, fps=Slider(60, range=0..100), duration=Slider(2, range=0..10))  # -> out, CSV; inputs leds: list of Point3d, fps: Int32, duration: Int32
# ---------- c_script_13: C# ----------
    // Algorithm

    // How many lights do we have?
    int ledCount = leds.Count;

    // Prepare the basics of our CSV file
    List<string> csv = new List<string>();

    // Add the header, looking like:
    // "FRAME_ID,R_0,G_0,B_0,R_1,G_1,B_1..."
    string row = "FRAME_ID,";
    for (int i = 0; i < ledCount; i++)
    {
      row += "R_" + i + ",G_" + i + ",B_" + i;
      if (i != ledCount - 1)
      {
        row += ",";
      }
    }
    csv.Add(row);

    // Total length of animation
    int frameCount = fps * duration;

    // Angle step for each frame
    double thetaStep = 2 * Math.PI / frameCount;

    // Generate rows for each frame
    for (int f = 0; f < frameCount; f++)
    {
      row = f + ",";

      double theta = thetaStep * f;
      double amplitude = 0.5 + 0.5 * Math.Sin(theta - 0.5 * Math.PI);
      Print("Frame " + f + ", theta: " + theta + ", amplitude: " + amplitude);

      // Calculate the values for each LED
      int r, g, b;
      for (int i = 0; i < ledCount; i++)
      {
        // Calculate RGB values for each LED
        int brightness = (int) Math.Round(255 * amplitude);

        // For this one, all LEDs are black.
        r = brightness;
        g = brightness;
        b = brightness;

        // Add these colors to the row
        row += r + "," + g + "," + b;
        if (i != ledCount - 1)
        {
          row += ",";
        }
      }

      // Add this row to the CSV
      csv.Add(row);
    }


    // Outputs
    CSV = csv;
# ---------- end c_script_13 ----------
panel_15 = Panel(c_script_13.CSV)
c_script_14 = CSharpScript(csv=c_script_13.CSV, path=concat_7)  # -> out; inputs csv: list of String, path: String; same code as c_script_4
panel_16 = Panel(c_script_14)

# ----
txt = Text(c_script_11.CSV)
txt_2 = Text(c_script_7.CSV)
txt_3 = Text(c_script_3.CSV)
txt_4 = Text(c_script_5.CSV)
txt_5 = Text(c_script_13.CSV)
txt_6 = Text(c_script_9.CSV)
concat_8 = Concatenate(FragmentA=path, FragmentB="\", FragmentC="pulse-random-color.csv")

# ---- group: PULSE RANDOM COLOR
c_script_15 = CSharpScript(leds=pt, fps=Slider(60, range=0..100), duration=Slider(2, range=0..10))  # -> out, CSV; inputs leds: list of Point3d, fps: Int32, duration: Int32
# ---------- c_script_15: C# ----------
    // Algorithm

    // How many lights do we have?
    int ledCount = leds.Count;

    // Prepare the basics of our CSV file
    List<string> csv = new List<string>();

    // Add the header, looking like:
    // "FRAME_ID,R_0,G_0,B_0,R_1,G_1,B_1..."
    string row = "FRAME_ID,";
    for (int i = 0; i < ledCount; i++)
    {
      row += "R_" + i + ",G_" + i + ",B_" + i;
      if (i != ledCount - 1)
      {
        row += ",";
      }
    }
    csv.Add(row);

    // Total length of animation
    int frameCount = fps * duration;

    // Angle step for each frame
    double thetaStep = 2 * Math.PI / frameCount;

    // Generate random initial angles for each LED light
    Random rand = new Random();
    List<double> initTheta = new List<double>();
    for (int i = 0; i < ledCount; i++)
    {
      double rt = 2 * Math.PI * rand.NextDouble();
      initTheta.Add(rt);
    }

    // Generate random distribution of colors
    List<bool> isRed = new List<bool>();
    for (int i = 0; i < ledCount; i++)
    {
      int ri = rand.Next(0, 2);
      isRed.Add(ri == 0 ? false : true);
    }


    // Generate rows for each frame
    for (int f = 0; f < frameCount; f++)
    {
      row = f + ",";


      // Calculate the values for each LED
      int r, g, b;
      for (int i = 0; i < ledCount; i++)
      {
        // Calculate RGB values for each LED
        double theta = thetaStep * f;
        double amplitude = 0.5 + 0.5 * Math.Sin(theta - 0.5 * Math.PI + initTheta[i]);
        Print("Frame " + f + ", theta: " + theta + ", amplitude: " + amplitude);

        int brightness = (int) Math.Round(255 * amplitude);

        // Choose red or green
        if (isRed[i])
        {
          r = brightness;
          g = 0;
          b = 0;
        }
        else
        {
          r = 0;
          g = brightness;
          b = 0;
        }

        // Add these colors to the row
        row += r + "," + g + "," + b;
        if (i != ledCount - 1)
        {
          row += ",";
        }
      }

      // Add this row to the CSV
      csv.Add(row);
    }


    // Outputs
    CSV = csv;
# ---------- end c_script_15 ----------
panel_17 = Panel(c_script_15.CSV)
c_script_16 = CSharpScript(csv=c_script_15.CSV, path=concat_8)  # -> out; inputs csv: list of String, path: String; same code as c_script_4
panel_18 = Panel(c_script_16)

# ----
txt_7 = Text(c_script_15.CSV)
trigger = Trigger(Interval=20, TimerInterval=20, Target=c_script_17)  # disabled
split_2 = SplitList(List=txt, Index="1")  # -> ListA, ListB

# ---- group: Per-frame simulation
c_script_17 = CSharpScript(csv=split_2.ListB, reset=Button(), loop=Toggle(True), minAlpha=Slider(152, range=0..255))  # -> out, renderedFrame, ledCount, colors, transparencies; inputs csv: list of String, reset: Boolean, loop: Boolean, minAlpha: Int32
# ---------- c_script_17: C# usings ----------
using System.Drawing;
# ---------- c_script_17: C# ----------
    // Algorithm

    // Do we need to reset?
    if (reset)
    {
      currentFrame = 0;
    }

    // Calculate total amount of frames
    int totalFrames = csv.Count - 1;

    // Select the row that contains the current frame to render
    string currentCSV = csv[currentFrame];

    // Splir the string into individual values
    string[] data = currentCSV.Split(',');

    // Calculate amount of ledLights
    int leds = (data.Length - 1) / 3;

    // Iterate over all the data points (minus the id)
    Color[] clrs = new Color[leds];
    double[] trans = new double[leds];
    for (int i = 0; i < leds; i++)
    {
      string strR = data[1 + 3 * i];
      string strG = data[1 + 3 * i + 1];
      string strB = data[1 + 3 * i + 2];

      int r = Int32.Parse(strR);
      int g = Int32.Parse(strG);
      int b = Int32.Parse(strB);

      int a = (r + g + b) / 3;
      if (a < minAlpha)
      {
        a = minAlpha;
      }

      double t = 1.0 - (a / 255.0);
      trans[i] = t;

      clrs[i] = Color.FromArgb(a, r, g, b);

    }

    // Update for next iteration
    currentFrame++;

    // Figure out if frame value is valid
    if (currentFrame > totalFrames - 1)
    {
      if (loop)
      {
        currentFrame = 0;
      }
      else
      {
        currentFrame = totalFrames - 1;
      }
    }


    // Outputs
    renderedFrame = currentFrame;
    ledCount = leds;
    colors = clrs;
    transparencies = trans;
# ---------- c_script_17: C# additional code ----------
  int currentFrame = 0;
# ---------- end c_script_17 ----------
panel_19 = Panel(c_script_17.colors)
panel_20 = Panel(c_script_17.ledCount)
panel_21 = Panel(c_script_17.transparencies)

# ----
panel_22 = Panel(c_script_17.renderedFrame)

# ---- group: Custom Rendering
number_slider = Slider(5, range=0..10)
material = CreateMaterial(
    Diffuse=c_script_17.colors,
    Specular=RGB(255, 255, 255),
    Emission=RGB(0, 0, 0),
    Transparency=c_script_17.transparencies,
    Shine=0)
msphere = MeshSphere(Base=pt, Radius=Slider(0.02, range=0..1), UCount=number_slider, VCount=number_slider)
preview = CustomPreview(Geometry=msphere, Material=material)
