# Grasshopper definition xmas_tree_simulation.gh (Grasshopper 1.0.7)

# ---- group: Load LED spatial locations
c_script = CSharpScript()  # -> out, here
# ---------- c_script: C# usings ----------
using System.IO;
# ---------- c_script: C# ----------
    string targetFolder = "";

    GH_Document gh_d = owner.OnPingDocument();
    if (gh_d.IsFilePathDefined)
    {
      string ghFilePath = gh_d.FilePath;
      targetFolder = Path.GetDirectoryName(ghFilePath);
    }
    else
    {
      Print("No local folder found, please save your file first.");
    }

    here = targetFolder;
# ---------- end c_script ----------
concat = Concatenate(FragmentA=c_script.here, FragmentB="\", FragmentC="coords_adjusted_normalized.csv")
panel = Panel(concat)
file = ReadFile(File=concat, PerLineParse=True)
panel_2 = Panel(file)
split = SplitList(List=file, Index="1")  # -> ListA, ListB
panel_3 = Panel(split.ListB)
c_script_2 = CSharpScript(coord=split.ListB)  # -> out, P; inputs coord: String
# ---------- c_script_2: C# ----------
  
    string[] parts = coord.Split(',');
    
    double x = 0, y = 0, z = 0;
    try
    {
      x = Double.Parse(parts[1]);
      y = Double.Parse(parts[2]);
      z = Double.Parse(parts[3]);
    }
    catch (Exception ex)
    {
      Component.AddRuntimeMessage(
      GH_RuntimeMessageLevel.Error, 
      "Invalid string: " + ex.ToString());
    }
    
    Point3d p = new Point3d(x, y, z);
    
    
    P = p;
# ---------- end c_script_2 ----------
panel_4 = Panel(c_script_2.P)

# ----
panel_5 = Panel("C:\Users\jlx\Desktop\xmas-tree\pulse_random_green_red_range_2_10s.csv")
panel_6 = Panel("C:\Users\jlx\Desktop\xmas-tree\pulse_random_range_1_10s.csv")
panel_7 = Panel("C:\Users\jlx\Desktop\xmas-tree\pulse_steady_5s.csv")

# ---- group: Load light sequence
panel_8 = Panel("C:\Users\jlx\Desktop\xmas-tree\moving_plane.csv")
file_2 = ReadFile(File="C:\Users\jlx\Desktop\xmas-tree\moving_rainbow.csv", PerLineParse=True)
split_2 = SplitList(List=file_2, Index="1")  # -> ListA, ListB

# ---- group: Per-frame simulation
c_script_3 = CSharpScript(csv=split_2.ListB, frame=Slider(76, range=0..151), minAlpha=Slider(114, range=0..255))  # -> out, ledCount, colors, transparencies; inputs csv: list of String, frame: Int32, minAlpha: Int32
# ---------- c_script_3: C# usings ----------
using System.Drawing;
# ---------- c_script_3: C# ----------
    // Algorithm

    // Select the row that contains the current frame to render
    string currentCSV = csv[frame];

    // Splir the string into individual values
    string[] data = currentCSV.Split(',');

    // Calculate amount of ledLights
    int leds = (data.Length - 1) / 3;

    // Iterate over all the data points (minus the id)
    Color[] clrs = new Color[leds];
    double[] trans = new double[leds];
    for (int i = 0; i < leds; i++)
    {
      string strR = data[1 + 3 * i];
      string strG = data[1 + 3 * i + 1];
      string strB = data[1 + 3 * i + 2];

      int r = Int32.Parse(strR);
      int g = Int32.Parse(strG);
      int b = Int32.Parse(strB);

      int a = (r + g + b) / 3;
      if (a < minAlpha)
      {
        a = minAlpha;
      }

      double t = 1.0 - (a / 255.0);
      trans[i] = t;

      clrs[i] = Color.FromArgb(a, r, g, b);

    }


    ledCount = leds;
    colors = clrs;
    transparencies = trans;
# ---------- end c_script_3 ----------
panel_9 = Panel(c_script_3.colors)
panel_10 = Panel(c_script_3.ledCount)
panel_11 = Panel(c_script_3.transparencies)

c_script_4 = CSharpScript(csv=split_2.ListB, reset=Button(), loop=Toggle(True), minAlpha=Slider(152, range=0..255))  # -> out, renderedFrame, ledCount, colors, transparencies; inputs csv: list of String, reset: Boolean, loop: Boolean, minAlpha: Int32
# ---------- c_script_4: C# ----------
    // Algorithm
    
    // Do we need to reset?
    if (reset)
    {
      currentFrame = 0;
    }
    
    // Calculate total amount of frames
    int totalFrames = csv.Count - 1;

    // Select the row that contains the current frame to render
    string currentCSV = csv[currentFrame];

    // Splir the string into individual values
    string[] data = currentCSV.Split(',');

    // Calculate amount of ledLights
    int leds = (data.Length - 1) / 3;

    // Iterate over all the data points (minus the id)
    Color[] clrs = new Color[leds];
    double[] trans = new double[leds];
    for (int i = 0; i < leds; i++)
    {
      string strR = data[1 + 3 * i];
      string strG = data[1 + 3 * i + 1];
      string strB = data[1 + 3 * i + 2];

      int r = Int32.Parse(strR);
      int g = Int32.Parse(strG);
      int b = Int32.Parse(strB);

      int a = (r + g + b) / 3;
      if (a < minAlpha)
      {
        a = minAlpha;
      }

      double t = 1.0 - (a / 255.0);
      trans[i] = t;

      clrs[i] = Color.FromArgb(a, r, g, b);

    }

    // Update for next iteration
    currentFrame++;

    // Figure out if frame value is valid
    if (currentFrame > totalFrames - 1)
    {
      if (loop)
      {
        currentFrame = 0;
      }
      else
      {
        currentFrame = totalFrames - 1;
      }
    }


    // Outputs
    renderedFrame = currentFrame;
    ledCount = leds;
    colors = clrs;
    transparencies = trans;
# ---------- c_script_4: C# additional code ----------
  int currentFrame = 0;
# ---------- end c_script_4 ----------
panel_12 = Panel(c_script_4.colors)
panel_13 = Panel(c_script_4.ledCount)
panel_14 = Panel(c_script_4.transparencies)

# ----
trigger = Trigger(Interval=20, TimerInterval=20, Target=c_script_4)  # disabled
panel_15 = Panel(c_script_4.renderedFrame)

# ---- group: Render LED lights
number_slider = Slider(5, range=0..10)
material = CreateMaterial(
    Diffuse=c_script_4.colors,
    Specular=RGB(255, 255, 255),
    Emission=RGB(0, 0, 0),
    Transparency=c_script_4.transparencies,
    Shine=0)
msphere = MeshSphere(Base=c_script_2.P, Radius=Slider(0.02, range=0..1), UCount=number_slider, VCount=number_slider)
preview = CustomPreview(Geometry=msphere, Material=material)
