# Grasshopper definition xmas_tree_sequences_joseluis.ghx (Grasshopper 1.0.7)

# ---- group: Load LED spatial locations
c_script = CSharpScript()  # -> out, here
# ---------- c_script: C# usings ----------
using System.IO;
# ---------- c_script: C# ----------
    string targetFolder = "";

    GH_Document gh_d = owner.OnPingDocument();
    if (gh_d.IsFilePathDefined)
    {
      string ghFilePath = gh_d.FilePath;
      targetFolder = Path.GetDirectoryName(ghFilePath);
    }
    else
    {
      Print("No local folder found, please save your file first.");
    }

    here = targetFolder;
# ---------- end c_script ----------
concat = Concatenate(FragmentA=c_script.here, FragmentB="\", FragmentC="pcamp_tree_coords.csv")
panel = Panel(concat)
file = ReadFile(File=concat, PerLineParse=True)
panel_2 = Panel(file)
split = SplitList(List=file, Index="1")  # -> ListA, ListB
panel_3 = Panel(split.ListB)
c_script_2 = CSharpScript(coord=split.ListB)  # -> out, P; inputs coord: String
# ---------- c_script_2: C# ----------
  
    string[] parts = coord.Split(',');
    
    double x = 0, y = 0, z = 0;
    try
    {
      x = Double.Parse(parts[1]);
      y = Double.Parse(parts[2]);
      z = Double.Parse(parts[3]);
    }
    catch (Exception ex)
    {
      Component.AddRuntimeMessage(
      GH_RuntimeMessageLevel.Error, 
      "Invalid string: " + ex.ToString());
    }
    
    Point3d p = new Point3d(x, y, z);
    
    
    P = p;
# ---------- end c_script_2 ----------
panel_4 = Panel(c_script_2.P)
pt = Point(c_script_2.P)

# ---- group: gold
rgb = ColourRGB(Alpha=255, Red=Slider(218, range=0..255), Green=Slider(165, range=0..255), Blue=Slider(32, range=0..255))

# ---- group: pink
rgb_2 = ColourRGB(Alpha=255, Red=Slider(229, range=0..255), Green=Slider(203, range=0..255), Blue=Slider(206, range=0..255))

rgb_3 = ColourRGB(Alpha=255, Red=Slider(255, range=0..255), Green=Slider(115, range=0..255), Blue=Slider(121, range=0..255))

# ---- group: gold
rgb_4 = ColourRGB(Alpha=255, Red=Slider(127, range=0..255), Green=Slider(114, range=0..255), Blue=Slider(255, range=0..255))

# ----
path = FilePath(c_script.here)
pt_2 = Point(pt)

# ---- group: Generate a CSV sequence with HSV rainboe planes of light traversing the tree vertically
c_script_3 = CSharpScript(leds=pt_2, fps="60", totalTime=Slider(2, range=0..50))  # -> out, CSV; inputs leds: list of Point3d, fps: Int32, totalTime: Int32
# ---------- c_script_3: C# usings ----------
using System.Drawing;
# ---------- c_script_3: C# ----------
    // This script generates a sequence of white ligths imitating a plane that moves
    // from the bottom to the top of the tree at linear speed.

    // Let's create a list of strings which will become the CSV file
    List<string> csv = new List<string>();

    // Add a header line, which columns for the frame ID and RGB vlaues for each pixel
    string header = "FRAME_ID,";
    for (int i = 0; i < leds.Count; i++)
    {
      header += "R_" + i + ",G_" + i + ",B_" + i;

      // Add trailing comma only if not the last LED
      if (i < leds.Count - 1)
      {
        header += ",";
      }
    }
    csv.Add(header);

    // Find Z coords of top + lower pixels
    double minZ = double.MaxValue;
    double maxZ = double.MinValue;
    for (int i = 0; i < leds.Count; i++)
    {
      if (leds[i].Z > maxZ)
      {
        maxZ = leds[i].Z;
      }
      if (leds[i].Z < minZ)
      {
        minZ = leds[i].Z;
      }
    }


    // Tree height
    double height = maxZ - minZ;

    // Calculate how many frames are we generating
    int totalFrames = fps * totalTime;

    // Calculate Z step for each frame
    double stepHue = 360.0 / totalFrames;

    // Compute data for each frame
    for (int f = 0; f < totalFrames; f++)
    {
      // Start an empty string which will become the new CSV line
      string line = "";

      // Add to this line the number of the frame, followed by a comma
      line += f + ",";


      // Now we need to calculate color values for each LED
      for (int ledID = 0; ledID < leds.Count; ledID++)
      {
        // Initialize color values
        byte r = 0, g = 0, b = 0;


        // Hue
        double hue = 360 * (leds[ledID].Z - minZ / height) + f * stepHue;
        Color clr = ColorFromHSV(hue, 1, 1);

        r = clr.R;
        g = clr.G;
        b = clr.B;



        // Take the RGB values and add them to the CSV line
        line += r + "," + g + "," + b;

        // Don't add trailing comma if this is the last LED!
        if (ledID < leds.Count - 1)
        {
          line += ",";
        }
      }

      // Add the newly created line to the csv list
      csv.Add(line);
    }

    // Output
    CSV = csv;
# ---------- c_script_3: C# additional code ----------
  // From: https://stackoverflow.com/a/1626232/1934487
  public static void ColorToHSV(Color color, out double hue, out double saturation, out double value)
  {
    int max = Math.Max(color.R, Math.Max(color.G, color.B));
    int min = Math.Min(color.R, Math.Min(color.G, color.B));

    hue = color.GetHue();
    saturation = (max == 0) ? 0 : 1d - (1d * min / max);
    value = max / 255d;
  }
  
// From: https://stackoverflow.com/a/1626232/1934487
  public static Color ColorFromHSV(double hue, double saturation, double value)
  {
    int hi = Convert.ToInt32(Math.Floor(hue / 60)) % 6;
    double f = hue / 60 - Math.Floor(hue / 60);

    value = value * 255;
    int v = Convert.ToInt32(value);
    int p = Convert.ToInt32(value * (1 - saturation));
    int q = Convert.ToInt32(value * (1 - f * saturation));
    int t = Convert.ToInt32(value * (1 - (1 - f) * saturation));

    if (hi == 0)
      return Color.FromArgb(255, v, t, p);
    else if (hi == 1)
      return Color.FromArgb(255, q, v, p);
    else if (hi == 2)
      return Color.FromArgb(255, p, v, t);
    else if (hi == 3)
      return Color.FromArgb(255, p, q, v);
    else if (hi == 4)
      return Color.FromArgb(255, t, p, v);
    else
      return Color.FromArgb(255, v, p, q);
  }
# ---------- end c_script_3 ----------
concat_2 = Concatenate(FragmentA=path, FragmentB="\", FragmentC="moving_rainbow.csv")
panel_5 = Panel(concat_2)
c_script_4 = CSharpScript(text=c_script_3.CSV, path=concat_2)  # -> out; inputs text: list of String, path: String
# ---------- c_script_4: C# usings ----------
using System.IO;
using System.Text;
# ---------- c_script_4: C# ----------
    // This file takes a list of strings and saves them to a file somewhere in your system

    try
    { 
      File.WriteAllLines(path, text, Encoding.UTF8);
      
      string msg = text.Count + " lines successfully written to file " + path + " on " + DateTime.Now;
      Print(msg);
      
    }
    catch (Exception ex)
    {
      this.Component.AddRuntimeMessage(GH_RuntimeMessageLevel.Error, "Something went wrong saving the file: " + ex);
    }
# ---------- end c_script_4 ----------
panel_6 = Panel(c_script_4)

# ----
number_slider = Slider(1, range=0..2)

# ---- group: Lights pulsing with a random offset - Same as above, but TWO COLORS
number_slider_2 = Slider(10, range=0..10)
c_script_5 = CSharpScript(leds=pt_2, fps="60", range=number_slider, colorA=rgb_4, colorB=rgb_3, totalTime=number_slider_2)  # -> out, CSV; inputs leds: list of Point3d, fps: Int32, range: Double, colorA: Color, colorB: Color, totalTime: Int32
# ---------- c_script_5: C# ----------
    // Let's create a list of strings which will become the CSV file
    List<string> csv = new List<string>();

    // Add a header line, which columns for the frame ID and RGB vlaues for each pixel
    string header = "FRAME_ID,";
    for (int i = 0; i < leds.Count; i++)
    {
      header += "R_" + i + ",G_" + i + ",B_" + i;

      // Add trailing comma only if not the last LED
      if (i < leds.Count - 1)
      {
        header += ",";
      }
    }
    csv.Add(header);





    // Calculate how many frames are we generating
    int totalFrames = fps * totalTime;

    // Calculate angle step for each frame
    double stepTheta = 2 * Math.PI / totalFrames;

    // Create a set of random thetas to start each LED
    // Range defines how disperse the initial sample is:
    // 2.0 covers full spectrum, blinks constantly
    // 1.0 covers half spectrum, leds remain off half the time
    // 0.5 covers a quarter of the spectrum, leds remain off 75% of the time...
    double[] thetas = new double[leds.Count];
    var rand = new Random();
    for (int i = 0; i < leds.Count; i++)
    {
      thetas[i] = range * Math.PI * rand.NextDouble();
    }

    // Randomly assign red or green
    bool[] isRed = new bool[leds.Count];
    for (int i = 0; i < leds.Count; i++)
    {
      isRed[i] = Convert.ToBoolean(rand.Next(2));
    }


    // Compute data for each frame
    for (int f = 0; f < totalFrames; f++)
    {
      // Start an empty string which will become the new CSV line
      string line = "";

      // Add to this line the number of the frame, followed by a comma
      line += f + ",";


      // Now we need to calculate color values for each LED
      for (int ledID = 0; ledID < leds.Count; ledID++)
      {
        // Initialize color values
        int r = 0, g = 0, b = 0;

        // Figure out the brightness value of this led
        double osc = Math.Cos(thetas[ledID] + f * stepTheta);  // offset by initial random angle

        // Adjust RGB to that value
        if (isRed[ledID])
        {
          // gold: (218,165,32)
          r = (int) Math.Round(colorA.R * osc);
          g = (int) Math.Round(colorA.G * osc);
          b = (int) Math.Round(colorA.B * osc);
        }
        else
        {
          // pink: 229, 203, 206
          r = (int) Math.Round(colorB.R * osc);
          g = (int) Math.Round(colorB.G * osc);
          b = (int) Math.Round(colorB.B * osc);
        }

        if (r < 0) r = 0;
        if (g < 0) g = 0;
        if (b < 0) b = 0;

        // Take the RGB values and add them to the CSV line
        line += r + "," + g + "," + b;

        // Don't add trailing comma if this is the last LED!
        if (ledID < leds.Count - 1)
        {
          line += ",";
        }
      }

      // Add the newly created line to the csv list
      csv.Add(line);
    }

    // Output
    CSV = csv;
# ---------- end c_script_5 ----------
concat_3 = Concatenate(
    FragmentA=path,
    FragmentB="\",
    FragmentC="pulse_random_two_colors_range_",
    FragmentD=number_slider,
    FragmentE="_",
    FragmentF=number_slider_2,
    FragmentG="s.csv")
panel_7 = Panel(concat_3)
c_script_6 = CSharpScript(text=c_script_5.CSV, path=concat_3)  # -> out; inputs text: list of String, path: String; same code as c_script_4
panel_8 = Panel(c_script_6)

# ----
number_slider_3 = Slider(2, range=0..2)

# ---- group: Lights pulsing with a random offset
number_slider_4 = Slider(10, range=0..10)
c_script_7 = CSharpScript(leds=pt_2, fps="60", range=number_slider_3, totalTime=number_slider_4)  # -> out, CSV; inputs leds: list of Point3d, fps: Int32, range: Double, totalTime: Int32
# ---------- c_script_7: C# ----------
    // Let's create a list of strings which will become the CSV file
    List<string> csv = new List<string>();

    // Add a header line, which columns for the frame ID and RGB vlaues for each pixel
    string header = "FRAME_ID,";
    for (int i = 0; i < leds.Count; i++)
    {
      header += "R_" + i + ",G_" + i + ",B_" + i;

      // Add trailing comma only if not the last LED
      if (i < leds.Count - 1)
      {
        header += ",";
      }
    }
    csv.Add(header);





    // Calculate how many frames are we generating
    int totalFrames = fps * totalTime;

    // Calculate angle step for each frame
    double stepTheta = 2 * Math.PI / totalFrames;

    // Create a set of random thetas to start each LED
    // Range defines how disperse the initial sample is:
    // 2.0 covers full spectrum, blinks constantly
    // 1.0 covers half spectrum, leds remain off half the time
    // 0.5 covers a quarter of the spectrum, leds remain off 75% of the time...
    double[] thetas = new double[leds.Count];
    var rand = new Random();
    for (int i = 0; i < leds.Count; i++)
    {
      thetas[i] = range * Math.PI * rand.NextDouble();
    }

    // Compute data for each frame
    for (int f = 0; f < totalFrames; f++)
    {
      // Start an empty string which will become the new CSV line
      string line = "";

      // Add to this line the number of the frame, followed by a comma
      line += f + ",";


      // Now we need to calculate color values for each LED
      for (int ledID = 0; ledID < leds.Count; ledID++)
      {
        // Initialize color values
        byte r = 0, g = 0, b = 0;

        // Figure out the brightness value of this led
        double osc = Math.Cos(thetas[ledID] + f * stepTheta);  // offset by initial random angle
        // This doesn't work, negative values get wrapped as if with modulo...
        //        byte brightness = (byte) Math.Round(255 * osc);  // allow half the time to be neg (off)
        int B = (int) Math.Round(255 * osc);  // allow half the time to be neg (off)
        byte brightness = B < 0 ? (byte) 0 : (byte) B;

        // Adjust RGB to that value (resulting in white)
        r = brightness;
        g = brightness;
        b = brightness;

        // Take the RGB values and add them to the CSV line
        line += r + "," + g + "," + b;

        // Don't add trailing comma if this is the last LED!
        if (ledID < leds.Count - 1)
        {
          line += ",";
        }
      }

      // Add the newly created line to the csv list
      csv.Add(line);
    }

    // Output
    CSV = csv;
# ---------- end c_script_7 ----------
concat_4 = Concatenate(
    FragmentA=path,
    FragmentB="\",
    FragmentC="pulse_random_range_",
    FragmentD=number_slider_3,
    FragmentE="_",
    FragmentF=number_slider_4,
    FragmentG="s.csv")
panel_9 = Panel(concat_4)
c_script_8 = CSharpScript(text=c_script_7.CSV, path=concat_4)  # -> out; inputs text: list of String, path: String; same code as c_script_4
panel_10 = Panel(c_script_8)

# ----
pt_3 = Point(<point referenced from the Rhino model>)
panel_11 = Panel("""338
342""")

# ---- group: PULSE UNIFORM
c_script_9 = CSharpScript(leds=pt, fps=Slider(60, range=0..100), duration=Slider(5, range=0..10), ids=panel_11)  # -> out, CSV; inputs leds: list of Point3d, fps: Int32, duration: Int32, ids: list of Int32
# ---------- c_script_9: C# ----------
    // Algorithm

    // How many lights do we have?
    int ledCount = leds.Count;

    // Prepare the basics of our CSV file
    List<string> csv = new List<string>();

    // Add the header, looking like:
    // "FRAME_ID,R_0,G_0,B_0,R_1,G_1,B_1..."
    string row = "FRAME_ID,";
    for (int i = 0; i < ledCount; i++)
    {
      row += "R_" + i + ",G_" + i + ",B_" + i;
      if (i != ledCount - 1)
      {
        row += ",";
      }
    }
    csv.Add(row);

    // Total length of animation
    int frameCount = fps * duration;

    // Angle step for each frame
    double thetaStep = 2 * Math.PI / frameCount;

    // Generate rows for each frame
    for (int f = 0; f < frameCount; f++)
    {
      row = f + ",";

      double theta = thetaStep * f;
      double amplitude = 0.5 + 0.5 * Math.Sin(theta - 0.5 * Math.PI);
      Print("Frame " + f + ", theta: " + theta + ", amplitude: " + amplitude);

      // Calculate the values for each LED
      int r, g, b;
      for (int i = 0; i < ledCount; i++)
      {
        // Calculate RGB values for each LED
        int brightness = 0;
        
        if (ids.Contains(i)) brightness = (int) Math.Round(255 * amplitude);

        // For this one, all LEDs are black.
        r = brightness;
        g = brightness;
        b = brightness;

        // Add these colors to the row
        row += r + "," + g + "," + b;
        if (i != ledCount - 1)
        {
          row += ",";
        }
      }

      // Add this row to the CSV
      csv.Add(row);
    }


    // Outputs
    CSV = csv;
# ---------- end c_script_9 ----------
panel_12 = Panel(c_script_9.CSV)
concat_5 = Concatenate(FragmentB="\", FragmentC="pulsing-heart.csv")
c_script_10 = CSharpScript(csv=c_script_9.CSV, path=concat_5)  # -> out; inputs csv: list of String, path: String
# ---------- c_script_10: C# ----------
  
    try 
    {
      File.WriteAllLines(path, csv, Encoding.UTF8);
      Print("File successfully saved on " + DateTime.Now);
    }
    catch (Exception ex)
    {
      this.Component.AddRuntimeMessage(
        GH_RuntimeMessageLevel.Error,
        "Could not save file, error: " + ex);
    }
# ---------- end c_script_10 ----------
panel_13 = Panel(c_script_10)

c_script_11 = CSharpScript(
    leds=pt,
    fps=Slider(60, range=0..100),
    duration=Slider(5, range=0..10),
    waveCount=Slider(20, range=1..20),
    fullWave=Toggle(False))  # -> out, CSV; inputs leds: list of Point3d, fps: Int32, duration: Int32, waveCount: Int32, fullWave: Boolean
# ---------- c_script_11: C# ----------
    // Algorithm

    // How many lights do we have?
    int ledCount = leds.Count;

    // Prepare the basics of our CSV file
    List<string> csv = new List<string>();

    // Add the header, looking like:
    // "FRAME_ID,R_0,G_0,B_0,R_1,G_1,B_1..."
    string row = "FRAME_ID,";
    for (int i = 0; i < ledCount; i++)
    {
      row += "R_" + i + ",G_" + i + ",B_" + i;
      if (i != ledCount - 1)
      {
        row += ",";
      }
    }
    csv.Add(row);

    // Total length of animation
    int frameCount = fps * duration;

    // Angle step for each frame
    double thetaStep = 2 * Math.PI / frameCount;

    // Angle step between lights
    double ledStep = waveCount * 2 * Math.PI / (leds.Count);

    // Generate rows for each frame
    for (int f = 0; f < frameCount; f++)
    {
      row = f + ",";

      double theta = thetaStep * f;
      //      double amplitude = 0.5 + 0.5 * Math.Sin(theta - 0.5 * Math.PI);
      //      Print("Frame " + f + ", theta: " + theta + ", amplitude: " + amplitude);

      // Calculate the values for each LED
      int r, g, b;
      for (int i = 0; i < ledCount; i++)
      {
        // Calculate RGB values for each LED
        double sin = Math.Sin(i * ledStep - f * thetaStep);
        if (fullWave) sin = 0.5 + 0.5 * sin;
        int B = (int) Math.Round(255 * sin);
        if (B < 0) B = 0;

        // For this one, all LEDs are black.
        r = B;
        g = B;
        b = B;

        // Add these colors to the row
        row += r + "," + g + "," + b;
        if (i != ledCount - 1)
        {
          row += ",";
        }
      }

      // Add this row to the CSV
      csv.Add(row);
    }


    // Outputs
    CSV = csv;
# ---------- end c_script_11 ----------
panel_14 = Panel(c_script_11.CSV)
concat_6 = Concatenate(FragmentB="\", FragmentC="rolling-wave-20.csv")
c_script_12 = CSharpScript(csv=c_script_11.CSV, path=concat_6)  # -> out; inputs csv: list of String, path: String; same code as c_script_10
panel_15 = Panel(c_script_12)

# ---- group: All lights pulsing at the same rate
number_slider_5 = Slider(5, range=0..10)
c_script_13 = CSharpScript(leds=pt_2, fps="60", totalTime=number_slider_5)  # -> out, CSV; inputs leds: list of Point3d, fps: Int32, totalTime: Int32
# ---------- c_script_13: C# ----------
    // This script generates a sequence of white ligths imitating a plane that moves
    // from the bottom to the top of the tree at linear speed.

    // Let's create a list of strings which will become the CSV file
    List<string> csv = new List<string>();

    // Add a header line, which columns for the frame ID and RGB vlaues for each pixel
    string header = "FRAME_ID,";
    for (int i = 0; i < leds.Count; i++)
    {
      header += "R_" + i + ",G_" + i + ",B_" + i;

      // Add trailing comma only if not the last LED
      if (i < leds.Count - 1)
      {
        header += ",";
      }
    }
    csv.Add(header);




    // Calculate how many frames are we generating
    int totalFrames = fps * totalTime;

    // Calculate angle step for each frame
    double stepTheta = 2 * Math.PI / totalFrames;

    // Compute data for each frame
    for (int f = 0; f < totalFrames; f++)
    {
      // Start an empty string which will become the new CSV line
      string line = "";

      // Add to this line the number of the frame, followed by a comma
      line += f + ",";

      // Figure out the brightness value
      double osc = Math.Cos(Math.PI + f * stepTheta);  // offset by 180 to start black
      byte brightness = (byte) Math.Round(255 * (0.5 + 0.5 * osc));


      // Now we need to calculate color values for each LED
      for (int ledID = 0; ledID < leds.Count; ledID++)
      {
        // Initialize color values
        byte r = 0, g = 0, b = 0;


        // Adjust RGB to that value (resulting in white)
        r = brightness;
        g = brightness;
        b = brightness;

        // Take the RGB values and add them to the CSV line
        line += r + "," + g + "," + b;

        // Don't add trailing comma if this is the last LED!
        if (ledID < leds.Count - 1)
        {
          line += ",";
        }
      }

      // Add the newly created line to the csv list
      csv.Add(line);
    }

    // Output
    CSV = csv;
# ---------- end c_script_13 ----------
concat_7 = Concatenate(FragmentA=path, FragmentB="\", FragmentC="pulse_steady_", FragmentD=number_slider_5, FragmentE="s.csv")
panel_16 = Panel(concat_7)
c_script_14 = CSharpScript(text=c_script_13.CSV, path=concat_7)  # -> out; inputs text: list of String, path: String; same code as c_script_4
panel_17 = Panel(c_script_14)

# ---- group: FLUSH
c_script_15 = CSharpScript(leds=pt, fps=Slider(60, range=0..100), duration=Slider(1, range=0..10))  # -> out, CSV; inputs leds: list of Point3d, fps: Int32, duration: Int32
# ---------- c_script_15: C# ----------
    // Algorithm

    // How many lights do we have?
    int ledCount = leds.Count;

    // Prepare the basics of our CSV file
    List<string> csv = new List<string>();

    // Add the header, looking like:
    // "FRAME_ID,R_0,G_0,B_0,R_1,G_1,B_1..."
    string row = "FRAME_ID,";
    for (int i = 0; i < ledCount; i++)
    {
      row += "R_" + i + ",G_" + i + ",B_" + i;
      if (i != ledCount - 1)
      {
        row += ",";
      }
    }
    csv.Add(row);

    // Total length of animation
    int frameCount = fps * duration;

    // Generate rows for each frame
    for (int f = 0; f < frameCount; f++)
    {
      row = f + ",";

      // Calculate the values for each LED
      int r, g, b;
      for (int i = 0; i < ledCount; i++)
      {
        // Calculate RGB values for each LED

        // For this one, all LEDs are black.
        r = 0;
        g = 0;
        b = 0;

        // Add these colors to the row
        row += r + "," + g + "," + b;
        if (i != ledCount - 1)
        {
          row += ",";
        }
      }

      // Add this row to the CSV
      csv.Add(row);
    }


    // Outputs
    CSV = csv;
# ---------- end c_script_15 ----------
panel_18 = Panel(c_script_15.CSV)
concat_8 = Concatenate(FragmentA=c_script.here, FragmentB="\", FragmentC="flush.csv")
c_script_16 = CSharpScript(csv=c_script_15.CSV, path=concat_8)  # -> out; inputs csv: list of String, path: String; same code as c_script_10
panel_19 = Panel(c_script_16)

# ----
concat_9 = Concatenate(FragmentA=c_script.here, FragmentB="\", FragmentC="pulse-red.csv")

# ---- group: PULSE UNIFORM
c_script_17 = CSharpScript(leds=pt, fps=Slider(60, range=0..100), duration=Slider(2, range=0..10))  # -> out, CSV; inputs leds: list of Point3d, fps: Int32, duration: Int32
# ---------- c_script_17: C# ----------
    // Algorithm

    // How many lights do we have?
    int ledCount = leds.Count;

    // Prepare the basics of our CSV file
    List<string> csv = new List<string>();

    // Add the header, looking like:
    // "FRAME_ID,R_0,G_0,B_0,R_1,G_1,B_1..."
    string row = "FRAME_ID,";
    for (int i = 0; i < ledCount; i++)
    {
      row += "R_" + i + ",G_" + i + ",B_" + i;
      if (i != ledCount - 1)
      {
        row += ",";
      }
    }
    csv.Add(row);

    // Total length of animation
    int frameCount = fps * duration;

    // Angle step for each frame
    double thetaStep = 2 * Math.PI / frameCount;

    // Generate rows for each frame
    for (int f = 0; f < frameCount; f++)
    {
      row = f + ",";

      double theta = thetaStep * f;
      double amplitude = 0.5 + 0.5 * Math.Sin(theta - 0.5 * Math.PI);
      Print("Frame " + f + ", theta: " + theta + ", amplitude: " + amplitude);

      // Calculate the values for each LED
      int r, g, b;
      for (int i = 0; i < ledCount; i++)
      {
        // Calculate RGB values for each LED
        int brightness = (int) Math.Round(255 * amplitude);

        // For this one, all LEDs are black.
        r = brightness;
        g = 0;
        b = 0;

        // Add these colors to the row
        row += r + "," + g + "," + b;
        if (i != ledCount - 1)
        {
          row += ",";
        }
      }

      // Add this row to the CSV
      csv.Add(row);
    }


    // Outputs
    CSV = csv;
# ---------- end c_script_17 ----------
panel_20 = Panel(c_script_17.CSV)
c_script_18 = CSharpScript(csv=c_script_17.CSV, path=concat_9)  # -> out; inputs csv: list of String, path: String; same code as c_script_10
panel_21 = Panel(c_script_18)

# ----
concat_10 = Concatenate(FragmentA=c_script.here, FragmentB="\", FragmentC="lighthouse.csv")

# ---- group: ROTATING LIGHT
c_script_19 = CSharpScript(leds=pt, fps=Slider(60, range=0..100), duration=Slider(8, range=0..10), center=pt_3, width=Slider(45, range=0..100))  # -> out, CSV; inputs leds: list of Point3d, fps: Int32, duration: Int32, center: Point3d, width: Double
# ---------- c_script_19: C# ----------
    // Algorithm

    // How many lights do we have?
    int ledCount = leds.Count;

    // Prepare the basics of our CSV file
    List<string> csv = new List<string>();

    // Add the header, looking like:
    // "FRAME_ID,R_0,G_0,B_0,R_1,G_1,B_1..."
    string row = "FRAME_ID,";
    for (int i = 0; i < ledCount; i++)
    {
      row += "R_" + i + ",G_" + i + ",B_" + i;
      if (i != ledCount - 1)
      {
        row += ",";
      }
    }
    csv.Add(row);

    // Total length of animation
    int frameCount = fps * duration;

    double step = 360.0 / frameCount;
    double diff = 360 - width;




    // Generate rows for each frame
    for (int f = 0; f < frameCount; f++)
    {
      row = f + ",";
      
      double frameAngle = f * step;

      // Calculate the values for each LED
      int r, g, b, brightness;
      for (int i = 0; i < ledCount; i++)
      {
        double dx = leds[i].X - center.X;
        double dy = leds[i].Y - center.Y;
        //                double angle = Math.Atan2(dy, dx) * 180 / Math.PI;  // ranges between [-180, 180]
        double ledAngle = Math.Atan2(dy, dx) * 180 / Math.PI + 180;  // ranges between [0, 360]

        if (ledAngle > frameAngle + diff) ledAngle -= 360;
        else if (ledAngle < frameAngle - diff) ledAngle += 360;

        brightness = 0;
        double d = frameAngle - ledAngle;
        if (d > -width && d < width)
        {
          brightness = (int) (255 * (1 - Math.Abs(d) / width));
        }

        r = brightness;
        g = brightness;
        b = brightness;

        // Add these colors to the row
        row += r + "," + g + "," + b;
        if (i != ledCount - 1)
        {
          row += ",";
        }
      }

      // Add this row to the CSV
      csv.Add(row);
    }


    // Outputs
    CSV = csv;
# ---------- c_script_19: C# additional code ----------
  // From https://stackoverflow.com/a/1626232/1934487
  public static void ColorToHSV(Color color, out double hue, out double saturation, out double value)
  {
    int max = Math.Max(color.R, Math.Max(color.G, color.B));
    int min = Math.Min(color.R, Math.Min(color.G, color.B));

    hue = color.GetHue();
    saturation = (max == 0) ? 0 : 1d - (1d * min / max);
    value = max / 255d;
  }

  // From https://stackoverflow.com/a/1626232/1934487
  public static Color ColorFromHSV(double hue, double saturation, double value)
  {
    int hi = Convert.ToInt32(Math.Floor(hue / 60)) % 6;
    double f = hue / 60 - Math.Floor(hue / 60);

    value = value * 255;
    int v = Convert.ToInt32(value);
    int p = Convert.ToInt32(value * (1 - saturation));
    int q = Convert.ToInt32(value * (1 - f * saturation));
    int t = Convert.ToInt32(value * (1 - (1 - f) * saturation));

    if (hi == 0)
      return Color.FromArgb(255, v, t, p);
    else if (hi == 1)
      return Color.FromArgb(255, q, v, p);
    else if (hi == 2)
      return Color.FromArgb(255, p, v, t);
    else if (hi == 3)
      return Color.FromArgb(255, p, q, v);
    else if (hi == 4)
      return Color.FromArgb(255, t, p, v);
    else
      return Color.FromArgb(255, v, p, q);
  }
# ---------- end c_script_19 ----------
panel_22 = Panel(c_script_19.CSV)
c_script_20 = CSharpScript(csv=c_script_19.CSV, path=concat_10)  # -> out; inputs csv: list of String, path: String; same code as c_script_10
panel_23 = Panel(c_script_20)

# ----
txt = Text(c_script_5.CSV)
txt_2 = Text(c_script_15.CSV)
txt_3 = Text(c_script_19.CSV)
txt_4 = Text(c_script_17.CSV)
txt_5 = Text()
txt_6 = Text()
txt_7 = Text()
trigger = Trigger(Interval=33, TimerInterval=33, Target=c_script_21)  # disabled
split_2 = SplitList(List=txt, Index="1")  # -> ListA, ListB

# ---- group: Per-frame simulation
c_script_21 = CSharpScript(csv=split_2.ListB, reset=Button(), loop=Toggle(True), minAlpha=Slider(152, range=0..255))  # -> out, renderedFrame, ledCount, colors, transparencies; inputs csv: list of String, reset: Boolean, loop: Boolean, minAlpha: Int32
# ---------- c_script_21: C# ----------
    // Algorithm

    // Do we need to reset?
    if (reset)
    {
      currentFrame = 0;
    }

    // Calculate total amount of frames
    int totalFrames = csv.Count - 1;

    // Select the row that contains the current frame to render
    string currentCSV = csv[currentFrame];

    // Splir the string into individual values
    string[] data = currentCSV.Split(',');

    // Calculate amount of ledLights
    int leds = (data.Length - 1) / 3;

    // Iterate over all the data points (minus the id)
    Color[] clrs = new Color[leds];
    double[] trans = new double[leds];
    for (int i = 0; i < leds; i++)
    {
      string strR = data[1 + 3 * i];
      string strG = data[1 + 3 * i + 1];
      string strB = data[1 + 3 * i + 2];

      int r = Int32.Parse(strR);
      int g = Int32.Parse(strG);
      int b = Int32.Parse(strB);

      int a = (r + g + b) / 3;
      if (a < minAlpha)
      {
        a = minAlpha;
      }

      double t = 1.0 - (a / 255.0);
      trans[i] = t;

      clrs[i] = Color.FromArgb(a, r, g, b);

    }

    // Update for next iteration
    currentFrame++;

    // Figure out if frame value is valid
    if (currentFrame > totalFrames - 1)
    {
      if (loop)
      {
        currentFrame = 0;
      }
      else
      {
        currentFrame = totalFrames - 1;
      }
    }


    // Outputs
    renderedFrame = currentFrame;
    ledCount = leds;
    colors = clrs;
    transparencies = trans;
# ---------- c_script_21: C# additional code ----------
  int currentFrame = 0;
# ---------- end c_script_21 ----------
panel_24 = Panel(c_script_21.colors)  # disabled
panel_25 = Panel(c_script_21.ledCount)
panel_26 = Panel(c_script_21.transparencies)  # disabled

# ----
panel_27 = Panel(c_script_21.renderedFrame)

# ---- group: Custom Rendering
number_slider_6 = Slider(5, range=0..10)
material = CreateMaterial(
    Diffuse=c_script_21.colors,
    Specular=RGB(255, 255, 255),
    Emission=RGB(0, 0, 0),
    Transparency=c_script_21.transparencies,
    Shine=0)
msphere = MeshSphere(Base=pt, Radius=Slider(0.02, range=0..1), UCount=number_slider_6, VCount=number_slider_6)
preview = CustomPreview(Geometry=msphere, Material=material)
